# Grasshopper definition rfem_lines_test 00.gh (Grasshopper 0.9.76)
# plug-ins: GHRFEM

crv = Curve([<curve referenced from the Rhino model> x6])
rfem_model_clear = DeleteAllElementsFromCurrentRFEMModel(RunTheElement=Toggle(False))
rfem_ln_write = LineRFEM(
    Curve=crv,
    MaxSegmentLength_m=Slider(5, range=0..10),
    TextToBeWrittenInRFEMCommentsField="comment for lines",
    Toggle=rfem_model_clear)  # -> RFEMLines, Success
rfem_mbr_write = MemberRFEM(
    RFEMLines=rfem_ln_write.RFEMLines,
    MemberSection="UB 203x133x25 (Corus)",
    MemberMaterial="NameID | Beton C30/37@TypeID|CONCRETE @NormID|DIN 1045-1 - 08",
    RotationBetaAngle=0,
    Toggle=rfem_ln_write.Success)  # -> RFEMMembers, Success
