# Grasshopper definition rfem_test 00.gh (Grasshopper 0.9.76)
# plug-ins: GHRFEM

panel = Panel("""6
7
9""")
pt = ConstructPoint(XCoordinate=0, YCoordinate=0, ZCoordinate=panel)
rfnd = NodeRFEM(Point=pt, Run=Toggle(False))
