# Grasshopper definition rfem_crv_to_poly 00.gh (Grasshopper 0.9.76)

number_slider = Slider(0.298, range=0.001..0.3)
crv = Curve(<curve referenced from the Rhino model>)
topoly = CurveToPolyline(Curve=crv, ToleranceDistance=0, ToleranceAngle=0, MinEdge=Slider(7, range=1..40))  # -> Polyline, Segments
crv_2 = Curve(<curve referenced from the Rhino model>)
panel = Panel(topoly.Segments)
crv_3 = Curve(topoly.Polyline)
explode = Explode(Curve=crv_2, Recursive=True)  # -> Segments, Vertices
panel_2 = Panel(crv_3)
panel_3 = Panel(explode.Segments)
explode_2 = Explode(Curve=crv_3, Recursive=True)  # -> Segments, Vertices
cp = ControlPoints(Curve=crv_3)  # -> Points, Weights, Knots
panel_4 = Panel(cp.Points)
panel_5 = Panel(explode_2.Segments)
cp_2 = ControlPoints(Curve=explode_2.Segments)  # -> simplify(Points), Weights, Knots
panel_6 = Panel(cp_2.Points)
