# Grasshopper definition RhFEM v0.04 example.gh (Grasshopper 0.9.76)
# plug-ins: GHRFEM

# ---- group: Toggle to run elements
rfem_model_clear = DeleteAllElementsFromCurrentRFEMModel(RunTheElement=Toggle(False))

# ---- group: Input geometry
crv = Curve([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])
srf = Surface([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])
pt = Point([Point(17.10069483, 0, -9.564764666), Point(23.21396334, 0, -9.463674404), Point(13.53702143, 10.43161725, -9.564764666), Point(18.37632461, 14.16078018, -9.463674404), Point(4.93573932, 16.3617885, -9.564764666), Point(6.700199775, 22.21090794, -9.463674404)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])

# ---- group: Writing Lines
rfem_ln_write = LineRFEM(Curve=crv, MaxSegmentLength_m=1, Toggle=rfem_model_clear)  # -> RFEMLines, Success
panel = Panel(rfem_ln_write.RFEMLines)

# ---- group: Writing Members
number_slider = Slider(0, range=0..100)
rfem_member_hinge = MemberHingeRFEM(
    SpringX_N_m=-1,
    SpringY_N_m=-1,
    SpringZ_N_m=-1,
    SpringXRotation_Nm_rad=-1,
    SpringYRotation_Nm_rad=number_slider,
    SpringZRotation_Nm_rad=number_slider)
rfem_member_hinge_2 = MemberHingeRFEM(
    SpringX_N_m=-1,
    SpringY_N_m=-1,
    SpringZ_N_m=-1,
    SpringXRotation_Nm_rad=number_slider,
    SpringYRotation_Nm_rad=number_slider,
    SpringZRotation_Nm_rad=number_slider)
rfem_materials = MaterialCatalogue("NameID|Baustahl S 275@TypeID|STEEL@NormID|EN 1993-1-1")
rfem_sections = SectionCatalogue("UB 203x133x25 (Corus)")
rfem_mbr_write = MemberRFEM(
    RFEMLines_RfLn=rfem_ln_write.RFEMLines,
    MemberSection=rfem_sections,
    MemberMaterial=rfem_materials,
    HingeAtMemberStart=rfem_member_hinge,
    HingeAtMemberEnd=rfem_member_hinge_2,
    Toggle=rfem_ln_write.Success)  # -> RFEMMembers, Success
panel_2 = Panel(rfem_mbr_write.RFEMMembers)

# ---- group: Writing Srufaces
rfem_materials_2 = MaterialCatalogue("NameID|Beton C32/40@TypeID|CONCRETE@NormID|BS EN 1992-1-1")
rfem_srf_write = SurfaceRFEM(
    Surfaces=srf,
    MaxSegmentLength_m=1,
    SurfaceThickness=Slider(0.05, range=0..0.1),
    SurfaceMaterial=rfem_materials_2,
    TextToBeWrittenInRFEMCommentsField="surfaces comment",
    Toggle=rfem_mbr_write.Success)  # -> RFEMSurfaces, Success
panel_3 = Panel(rfem_srf_write.RFEMSurfaces)

# ---- group: Writing Nodes
number_slider_2 = Slider(0, range=0..100)
rfem_node_supp = NodalSupportRFEM(
    SpringX_N_m=-1,
    SpringY_N_m=-1,
    SpringZ_N_m=-1,
    SpringXRotation_Nm_rad=number_slider_2,
    SpringYRotation_Nm_rad=number_slider_2,
    SpringZRotation_Nm_rad=number_slider_2,
    Comment="comment for nodal support")
rfem_nd_write = NodeRFEM(RhinoPoints=pt, RFEMSupport=rfem_node_supp, Toggle=rfem_srf_write.Success)  # -> RFEMNodes, Success
panel_4 = Panel(rfem_nd_write.RFEMNodes)
panel_5 = Panel(rfem_nd_write.Success)
